# Grasshopper definition DataDrivenImmediateAssembly.gh (Grasshopper 1.0.7)
# plug-ins: MeshEdit Components, Weaverbird, Kangaroo2 Components, SurfaceTrails2, Parakeet

# ---- group: hex cel starting size
number_slider = Slider(500, range=0..1000)

# ---- group: starting point for base grid
pt = Point(Point(0, 0, 0))

# ---- group: hex
multiplication = Multiplication(A=Slider(10, range=0..35), B=2)
hexgrid = Hexagonal(Plane=pt, Size=number_slider, ExtentX=multiplication, ExtentY=multiplication)  # -> Cells, Points
area = Area(Geometry=hexgrid.Cells)  # -> Area, Centroid
extr = ExtrudePoint(Base=hexgrid.Cells, Point=area.Centroid)  # -> flatten(Extrusion)
brepexplode = BrepExplode(Brep=extr)  # -> BrepFaces, BrepEdges, BrepVertices

# ---- group: hex / triangular cells
srf = Surface(brepexplode.BrepFaces)

# ---- group: Void to fill
brep = Brep(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)

# ----
neg = Negative(Value=Slider(169, range=0..10000))
brepoffset = OffsetBrep(Brep=brep, Distance=neg, Solid=False, BothSides=False, RoundCorners=True, MergeFaces=False)

number_slider_2 = Slider(10, range=0..10)
popgeo = PopulateGeometry(Geometry=brepoffset, Count=number_slider_2, Seed=number_slider_2)
pline = PolyLine(Vertices=popgeo, Closed=False)
crv = Curve(pline)

dispatch = Dispatch(List=flatten(srf), DispatchPattern=[True, False])  # -> ListA, ListB
flip = Flip(Surface=dispatch.ListA)  # -> Surface, Result
area_2 = Area(Geometry=dispatch.ListB)  # -> Area, Centroid
area_3 = Area(Geometry=flip.Surface)  # -> Area, Centroid
pl = PlaneNormal(Origin=area_3.Centroid, ZAxis=flip.Surface)
pl_2 = PlaneNormal(Origin=area_2.Centroid, ZAxis=flip.Surface)
division = Division(A="2", B="3")
weave = Weave(Pattern=[0, 1], Stream0=pl, Stream1=pl_2, NullGaps=False)
sqrt = SquareRoot(Value=division)
multiplication_2 = Multiplication(A=sqrt, B=number_slider)
amp = Amplitude(Vector=weave, Amplitude=multiplication_2)
dispatch_2 = Dispatch(List=amp, DispatchPattern=[True, False])  # -> ListA, ListB
neg_2 = Negative(Value=dispatch_2.ListA)
Z = UnitZ(Factor=multiplication_2)
weave_2 = Weave(Pattern=[0, 1], Stream0=neg_2, Stream1=dispatch_2.ListB, NullGaps=False)

item = ListItem(List=flatten(srf), Index=0, Wrap=True)

debrep = DeconstructBrep(Brep=item)  # -> Faces, Edges, Vertices
area_4 = Area(Geometry=srf)  # -> Area, Centroid
item_2 = ListItem(List=flatten(debrep.Edges), Index=0, Wrap=True)
item_3 = ListItem(List=flatten(area_4.Centroid), Index=0, Wrap=True)
item_4 = ListItem(List=flatten(debrep.Vertices), Index=0, Wrap=True)  # -> Item, Item1, Item2
midpt = CurveMiddle(Curve=item_2)
vec2pt = Vector2Pt(PointA=item_4.Item, PointB=item_3, Unitize=False)  # -> Vector, Length
vec2pt_2 = Vector2Pt(PointA=midpt, PointB=item_4.Item2, Unitize=False)  # -> Vector, Length
move = Move(Geometry=srf, Motion=vec2pt.Vector)  # -> Geometry, Transform
panel = Panel(vec2pt_2.Length)
srf_2 = Surface(move.Geometry)

debrep_2 = DeconstructBrep(Brep=brepoffset)  # -> Faces, Edges, Vertices
item_5 = ListItem(List=debrep_2.Faces, Index=0, Wrap=True)  # -> Item4, Item3, Item2, Item1, Item
srf_3 = Surface(item_5.Item)

# ---- group: cone development for connectors
panel_2 = Panel("3")
panel_3 = Panel("60")

# ---- group: atraction and flow parameters
explode = Explode(Curve=crv, Recursive=True)  # -> Segments, Vertices
midpt_2 = CurveMiddle(Curve=explode.Segments)
pl_3 = PlaneNormal(Origin=midpt_2, ZAxis=explode.Vertices)
cir = Circle(Plane=pl_3, Radius=Slider(0, range=0..300))
number_slider_3 = Slider(0, range=0..100)

popgeo_2 = PopulateGeometry(Geometry=srf_3, Count=Slider(48, range=0..50), Seed=Slider(5, range=0..10))
number_slider_4 = Slider(0, range=0..5)
cir_2 = Circle(Plane=popgeo_2, Radius=Slider(160, range=0..10000))
toggle = BooleanToggle(True)

# ----
area_5 = Area(Geometry=srf)  # -> Area, Centroid
move_2 = Move(Geometry=flatten(area_5.Centroid), Motion=weave_2)  # -> Geometry, Transform
extr_2 = ExtrudePoint(Base=flatten(srf), Point=move_2.Geometry)
cap = CapHoles(Brep=extr_2)

debrep_3 = DeconstructBrep(Brep=brep)  # -> Faces, Edges, Vertices
popgeo_3 = PopulateGeometry(Geometry=srf_3, Count=Slider(6, range=0..50), Seed=Slider(13, range=0..50))
pt_2 = Point(popgeo_3)

# ---- group: atraction and flow parameters
divide = DivideCurve(Curve=crv, Count=Slider(7, range=0..10), Kinks=False)  # -> flatten(Points), Tangents, Parameters
intcrv = Interpolate(Vertices=divide.Points, Degree=3, Periodic=True, KnotStyle=1)  # -> Curve, Length, Domain

number_slider_5 = Slider(40, range=0..200)
toggle_2 = BooleanToggle(False)

number_slider_6 = Slider(0, range=0..5)
number_slider_7 = Slider(1, range=0..100)

# ----
multiplication_3 = Multiplication(A=panel, B=Slider(0.667, range=0..1))
move_3 = Move(Geometry=cap, Motion=Z)  # -> Geometry, Transform
Y = UnitY(Factor=multiplication_3)
move_4 = Move(Geometry=move_3.Geometry, Motion=Y)  # -> Geometry, Transform
move_5 = Move(Geometry=move_4.Geometry, Motion=Z)  # -> Geometry, Transform
move_6 = Move(Geometry=move_5.Geometry, Motion=Y)  # -> Geometry, Transform

# ---- group: Containers
brepcontainment = BrepContainment(Brep=brepoffset, Multiplier=Slider(0, range=0..1000))
merge = Merge(Data1=brepcontainment)

# ---- group: Agent Parameters
flockagent3d = FlockAgent3D(MinimumVelocity=Slider(185, range=0..2000), MaximumVelocity=Slider(2859, range=0..8000), StartPointForAgent=pt_2)
fprops = FlockProperties(
    Timestep=Slider(0.09, range=0..1),
    NeighbourhoodRadius=Slider(47, range=0..1000),
    Alignment=Slider(0, range=0..1),
    Cohesion=Slider(7.32, range=0..100),
    Separation=Slider(5, range=0.01..5),
    SeparationDistance=Slider(1576.38, range=0..3000))

# ---- group: Behaviours
follow_curve = FollowCurveBehaviour(Curves=intcrv.Curve, Count=number_slider_7, Multiplier=number_slider_6, Loop=True)
attract = AttractingBehaviour(Circles=cir_2, AttractToNearestPoint=toggle, Multiplier=number_slider_4)
repellingbehaviour = RepellingBehaviour(Circles=cir, Multiplier=number_slider_3)
attractorcurve = AttractorCurveBehaviour(Curves=intcrv.Curve, StartPositionPosition=toggle_2, Multiplier=number_slider_5)
merge_2 = Merge(Data1=attract, Data2=attractorcurve, Data3=repellingbehaviour, Data5=follow_curve)  # -> flatten(Result)

# ----
merge_3 = Merge(Data1=cap, Data2=move_4.Geometry, Data3=move_6.Geometry)
multiplication_4 = Multiplication(A=multiplication_2, B="3")
Z_2 = UnitZ(Factor=multiplication_4)
arrlinear = LinearArray(Geometry=merge_3, Direction=Z_2, Count=Slider(18, range=0..20))  # -> Geometry, Transform
volume = Volume(Geometry=arrlinear.Geometry)  # -> Volume, Centroid

pt_3 = Point(flatten(volume.Centroid))
brep_2 = Brep([<brep referenced from the Rhino model> x72])  # disabled

brepinc = PointInBrep(Brep=brep, Point=pt_3, Strict=False)
dispatch_3 = Dispatch(List=flatten(arrlinear.Geometry), DispatchPattern=brepinc)  # -> ListA, ListB
brep_3 = Brep(dispatch_3.ListA)

clear = Button()
reset = Button()

volume_2 = Volume(Geometry=brep_3)  # -> Volume, Centroid
engine = FlockingEngine(
    UseParallel=True,
    UseRTree=True,
    Reset=reset,
    Play=Toggle(False),
    Agents=flockagent3d,
    FlockProperties=fprops,
    Behaviours=merge_2,
    Containment=merge)  # -> Positions, Velocities

# ---- group: Display
resettablerecorder = ResettableDataRecorder(Data=engine.Positions, Reset=reset, Clear=clear)
amp_2 = Amplitude(Vector=engine.Velocities, Amplitude=Slider(100, range=0..100))
vdis = VectorDisplay(Anchor=engine.Positions, Vector=amp_2)
pline_2 = PolyLine(Vertices=resettablerecorder, Closed=False)

# ---- group: Resulting path from Swarm
crv_2 = Curve(Tree({0;0}: [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], {0;1}: [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], {0;2}: [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], {0;3}: [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], {0;4}: [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], {0;5}: [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]))
crv_3 = Curve(pline_2)

# ----
crv_4 = Curve(crv_2)

# ---- group: selected tetra cells based on swarm path
divide_2 = DivideCurve(Curve=crv_4, Count=Slider(250, range=0..400), Kinks=False)  # -> Points, Tangents, Parameters
cps = ClosestPoints(Point=divide_2.Points, Cloud=volume_2.Centroid, Count=Slider(3, range=0..100))  # -> ClosestPoint, flatten(CPIndex), flatten(Distance)
sort = SortList(Keys=cps.CPIndex)  # -> Keys, ValuesA
dcon = DeleteConsecutive(Set=sort.Keys, Wrap=False)  # -> Set, Count
brep_4 = Brep(brep_3)
item_6 = ListItem(List=brep_4, Index=dcon.Set, Wrap=True)

# ---- group: selected tetra cells based on swarm path / INVERT POINT SELECTION
cull_i = CullIndex(List=flatten(pt_3), Indices=flatten(cps.CPIndex), Wrap=True)

# ----
number_slider_8 = Slider(3, range=0..3)  # disabled
number_slider_9 = Slider(60, range=0..100)  # disabled

# ---- group: reorienting collar flanges_BROKEN / WIP
panel_4 = Panel("3")  # disabled

# ----
number_slider_10 = Slider(100, range=0..100)
button = Button()

# ---- group: grouping cell by neighbors
dom = ConstructDomain(DomainStart=Slider(0, range=0..3), DomainEnd=Slider(3, range=0..3))

# ----
neg_3 = Negative(Value=Slider(6, range=0..10))

multiplication_5 = Multiplication(A=panel_3, B=2)

# ---- group: final tetra cells to use
brep_5 = Brep(item_6)
brep_6 = Brep(brep_5)
brep_7 = Brep(brep_6)

# ----
smesh = SimpleMesh(Brep=brep_7)
mesh = Mesh(smesh)

# ---- group: grouping cell by neighbors (continued)
smesh_2 = SimpleMesh(Brep=brep_7)
demesh = DeconstructMesh(Mesh=smesh_2)  # -> flatten(Vertices), Faces, Colours, Normals
area_6 = Area(Geometry=smesh_2)  # -> Area, Centroid

# ---- group: grouping cell by neighbors / CONNETTIVITY BY EDGE
wbedges = WeaverbirdsMeshEdges(MeshOrPolylines=smesh_2)
curvepoint = PointOnCurve(wbedges, parameter=0.5)

# ---- group: grouping cell by neighbors / CONNETTIVITY BY FACES
explode_2 = MeshExplode(Mesh=smesh_2, Interpolate=False)
facen = FaceNormals(Mesh=explode_2)  # -> flatten(Centers), Normals

# ---- group: grouping cell by neighbors (continued)
filter = StreamFilter(Gate=Slider(1, range=0..2), Stream0=facen.Centers, Stream1=curvepoint, Stream2=demesh.Vertices)
pt_4 = Point(flatten(filter))
duppt = RemoveDuplicatePts(Points=pt_4, Tolerance=0.01)
cps_2 = ClosestPoints(Point=area_6.Centroid, Cloud=duppt, Count="20")  # -> ClosestPoint, CPIndex, Distance

# ---- group: grouping cell by neighbors / INCREASE VALUE BY A % FACTOR
item_7 = ListItem(List=pt_4, Index=0, Wrap=True)
item_8 = ListItem(List=area_6.Centroid, Index=0, Wrap=True)
dist = Distance(PointA=item_7, PointB=item_8)
multiplication_6 = Multiplication(A=dist, B="1.1")

# ---- group: grouping cell by neighbors (continued)
smaller = SmallerThan(FirstNumber=cps_2.Distance, SecondNumber=multiplication_6)  # -> SmallerThan, OrEqualTo
dispatch_4 = Dispatch(List=cps_2.Distance, DispatchPattern=smaller.SmallerThan)  # -> ListA, ListB
lng = ListLength(List=dispatch_4.ListA)
bnd = Bounds(Numbers=flatten(lng))
panel_5 = Panel(bnd)
remap = RemapNumbers(Value=flatten(lng), Source=bnd, Target=dom)  # -> Mapped, Clipped

# ---- group: dispatch cells as breps for collars
sift = SiftPattern(List=flatten(brep_7), SiftPattern=remap.Mapped)  # -> Output0, Output1, Output2, Output3
null = NullItem(Item=sift.Output0)  # -> NullFlags, InvalidFlags, Description
null_2 = NullItem(Item=sift.Output1)  # -> NullFlags, InvalidFlags, Description
null_3 = NullItem(Item=sift.Output2)  # -> NullFlags, InvalidFlags, Description
null_4 = NullItem(Item=sift.Output3)  # -> NullFlags, InvalidFlags, Description
dispatch_5 = Dispatch(List=sift.Output0, DispatchPattern=null.NullFlags)  # -> ListA, ListB
dispatch_6 = Dispatch(List=sift.Output1, DispatchPattern=null_2.NullFlags)  # -> ListA, ListB
dispatch_7 = Dispatch(List=sift.Output2, DispatchPattern=null_3.NullFlags)  # -> ListA, ListB
dispatch_8 = Dispatch(List=sift.Output3, DispatchPattern=null_4.NullFlags)  # -> ListA, ListB
brep_8 = Brep(dispatch_8.ListB)
brep_9 = Brep(dispatch_7.ListB)
brep_10 = Brep(dispatch_5.ListB)
brep_11 = Brep(dispatch_6.ListB)
merge_4 = Merge(Data1=brep_10, Data2=brep_11, Data3=brep_9, Data4=brep_8)
brep_12 = Brep(merge_4)

# ----
item_9 = ListItem(List=brep_12, Index=0, Wrap=True)

brep_13 = Brep(item_9)
debrep_4 = DeconstructBrep(Brep=flatten(brep_13))  # -> Faces, Edges, Vertices
volume_3 = Volume(Geometry=brep_13)  # -> Volume, Centroid

edges = BrepEdges(Brep=debrep_4.Faces)  # -> Naked, Interior, NonManifold
join = JoinCurves(Curves=edges.Naked, Preserve=False)
explode_3 = Explode(Curve=join, Recursive=True)  # -> Segments, Vertices
crv_5 = Curve(explode_3.Segments)
midpt_3 = CurveMiddle(Curve=crv_5)

# ---- group: cone development for connectors
scale = Scale(Geometry=flatten(crv_5), Center=flatten(midpt_3), Factor=Slider(0.9, range=0..1))  # -> graft(Geometry), Transform
partition = PartitionList(List=flatten(scale.Geometry), Size=panel_2)
end = EndPoints(Curve=partition)  # -> Start, End
weave_3 = Weave(Pattern=[0, 1], Stream0=end.Start, Stream1=end.End, NullGaps=False)
item_10 = ListItem(List=simplify(weave_3), Index=0, Wrap=True)  # -> Item, Item1, Item2, Item3, Item4, Item5
pt_5 = Point(item_10.Item1)
pt_6 = Point(item_10.Item)
pt_7 = Point(item_10.Item2)
pt_8 = Point(item_10.Item3)
pt_9 = Point(item_10.Item4)
pt_10 = Point(item_10.Item5)
ln = Line(StartPoint=pt_8, EndPoint=pt_9)
ln_2 = Line(StartPoint=pt_5, EndPoint=pt_7)
ln_3 = Line(StartPoint=pt_6, EndPoint=pt_10)
join_2 = JoinCurves(Curves=flatten([ln_3, ln_2, ln]), Preserve=False)
explode_4 = Explode(Curve=join_2, Recursive=True)  # -> Segments, Vertices
midpt_4 = CurveMiddle(Curve=explode_4.Segments)
item_11 = ListItem(List=midpt_4, Index=0, Wrap=True)  # -> Item, Item1, Item2
circle = Circle3Pt(PointA=item_11.Item, PointB=item_11.Item1, PointC=item_11.Item2)  # -> Circle, Plane, Radius

scale_2 = Scale(Geometry=flatten(crv_5), Center=flatten(midpt_3), Factor=Slider(0.7, range=0..1))  # -> graft(Geometry), Transform
partition_2 = PartitionList(List=flatten(scale_2.Geometry), Size=panel_2)
end_2 = EndPoints(Curve=partition_2)  # -> Start, End
weave_4 = Weave(Pattern=[0, 1], Stream0=end_2.Start, Stream1=end_2.End, NullGaps=False)
item_12 = ListItem(List=simplify(weave_4), Index=0, Wrap=True)  # -> Item, Item1, Item2, Item3, Item4, Item5
pt_11 = Point(item_12.Item5)
pt_12 = Point(item_12.Item)
pt_13 = Point(item_12.Item1)
pt_14 = Point(item_12.Item2)
pt_15 = Point(item_12.Item3)
pt_16 = Point(item_12.Item4)
ln_4 = Line(StartPoint=pt_15, EndPoint=pt_16)
ln_5 = Line(StartPoint=pt_13, EndPoint=pt_14)
ln_6 = Line(StartPoint=pt_12, EndPoint=pt_11)
join_3 = JoinCurves(Curves=flatten([ln_6, ln_5, ln_4]), Preserve=False)
explode_5 = Explode(Curve=join_3, Recursive=True)  # -> Segments, Vertices
midpt_5 = CurveMiddle(Curve=explode_5.Segments)
item_13 = ListItem(List=midpt_5, Index=0, Wrap=True)  # -> Item, Item1, Item2
circle_2 = Circle3Pt(PointA=item_13.Item, PointB=item_13.Item1, PointC=item_13.Item2)  # -> Circle, Plane, Radius

# ----
rotate = Rotate(Geometry=circle.Circle, Angle=degrees(panel_3), Plane=circle.Circle)  # -> graft(Geometry), Transform
rotate_2 = Rotate(Geometry=circle_2.Circle, Angle=degrees(panel_3), Plane=circle_2.Circle)  # -> graft(Geometry), Transform
offset = OffsetCurve(Curve=rotate_2.Geometry, Distance=neg_3, Plane=rotate_2.Geometry, Corners=1)
offset_2 = OffsetCurve(Curve=rotate.Geometry, Distance=neg_3, Plane=rotate.Geometry, Corners=1)

rotate_3 = Rotate(Geometry=join_3, Angle=degrees(multiplication_5), Plane=flatten(circle_2.Circle))  # -> Geometry, Transform
rotate_4 = Rotate(Geometry=join_2, Angle=degrees(multiplication_5), Plane=flatten(circle.Circle))  # -> Geometry, Transform

# ---- group: dispatched and reorganized tetra cells according to neighboring cells
sift_2 = SiftPattern(List=flatten(brep_5), SiftPattern=remap.Mapped)  # -> Output0, Output1, Output2, Output3; disabled
null_5 = NullItem(Item=sift_2.Output0)  # -> NullFlags, InvalidFlags, Description
null_6 = NullItem(Item=sift_2.Output1)  # -> NullFlags, InvalidFlags, Description
null_7 = NullItem(Item=sift_2.Output2)  # -> NullFlags, InvalidFlags, Description
null_8 = NullItem(Item=sift_2.Output3)  # -> NullFlags, InvalidFlags, Description
dispatch_9 = Dispatch(List=sift_2.Output0, DispatchPattern=null_5.NullFlags)  # -> ListA, ListB
dispatch_10 = Dispatch(List=sift_2.Output1, DispatchPattern=null_6.NullFlags)  # -> ListA, ListB
dispatch_11 = Dispatch(List=sift_2.Output2, DispatchPattern=null_7.NullFlags)  # -> ListA, ListB
dispatch_12 = Dispatch(List=sift_2.Output3, DispatchPattern=null_8.NullFlags)  # -> ListA, ListB
brep_14 = Brep(dispatch_12.ListB)
brep_15 = Brep(dispatch_11.ListB)
brep_16 = Brep(dispatch_9.ListB)
brep_17 = Brep(dispatch_10.ListB)
merge_5 = Merge(Data1=brep_16, Data2=brep_17, Data3=brep_15, Data4=brep_14)

# ---- group: final tetra cells to use (continued)
brep_18 = Brep(merge_5)
brep_19 = Brep(brep_18)

# ----
sift_3 = SiftPattern(List=flatten(mesh), SiftPattern=remap.Mapped)  # -> Output0, Output1, Output2, Output3
null_9 = NullItem(Item=sift_3.Output0)  # -> NullFlags, InvalidFlags, Description
null_10 = NullItem(Item=sift_3.Output1)  # -> NullFlags, InvalidFlags, Description
null_11 = NullItem(Item=sift_3.Output2)  # -> NullFlags, InvalidFlags, Description
null_12 = NullItem(Item=sift_3.Output3)  # -> NullFlags, InvalidFlags, Description
dispatch_13 = Dispatch(List=sift_3.Output0, DispatchPattern=null_9.NullFlags)  # -> ListA, ListB
dispatch_14 = Dispatch(List=sift_3.Output1, DispatchPattern=null_10.NullFlags)  # -> ListA, ListB
dispatch_15 = Dispatch(List=sift_3.Output2, DispatchPattern=null_11.NullFlags)  # -> ListA, ListB
dispatch_16 = Dispatch(List=sift_3.Output3, DispatchPattern=null_12.NullFlags)  # -> ListA, ListB
mesh_2 = Mesh(dispatch_13.ListB)
mesh_3 = Mesh(dispatch_14.ListB)
mesh_4 = Mesh(dispatch_15.ListB)
mesh_5 = Mesh(dispatch_16.ListB)
merge_6 = Merge(Data1=mesh_2, Data2=mesh_3, Data3=mesh_4, Data4=mesh_5)
mesh_6 = Mesh(merge_6)

wbvertices = WeaverbirdsVerticesComponent(MeshClosedPolylinesGroup=mesh_6, Weld=True)
cluster = Cluster_2(L=wbvertices, P=remap.Mapped)
panel_6 = Panel(wbvertices)
pt_17 = Point(wbvertices)

panel_7 = Panel("6")
cullpt = CullDuplicates(Points=flatten(pt_17), Tolerance=Slider(6, range=0..10), CullMode=2)  # -> Points, Indices, Valence
cull_i_2 = CullIndex(List=flatten(pt_17), Indices=cullpt.Indices, Wrap=True)
replace = ReplaceItems(List=flatten(pt_17), Indices=cullpt.Indices, Wrap=False)
pt_18 = Point(cull_i_2)
partition_3 = PartitionList(List=replace, Size="4")

area_7 = Area(Geometry=flatten(circle_2.Circle))  # -> Area, Centroid; disabled
volume_4 = Volume(Geometry=mesh_6)  # -> Volume, Centroid; disabled
item_14 = ListItem(List=area_7.Centroid, Index=number_slider_8, Wrap=True)  # disabled
item_15 = ListItem(List=debrep_4.Vertices, Index=0, Wrap=True)  # disabled
vec2pt_3 = Vector2Pt(PointA=partition_3, PointB=graft(volume_4.Centroid), Unitize=False)  # -> Vector, Length; disabled
dist_2 = Distance(PointA=item_14, PointB=item_15)  # disabled
amp_3 = Amplitude(Vector=vec2pt_3.Vector, Amplitude=dist_2)  # disabled
pt_19 = Point(partition_3)  # disabled
ln_7 = Line(StartPoint=partition_3, EndPoint=graft(volume_4.Centroid))  # disabled
move_7 = Move(Geometry=pt_19, Motion=amp_3)  # -> Geometry, Transform; disabled
item_16 = ListItem(List=flatten(circle_2.Radius), Index=number_slider_8, Wrap=True)  # disabled
circle_3 = CircleCNR(Center=move_7.Geometry, Normal=ln_7, Radius=item_16)  # disabled
null_13 = NullItem(Item=circle_3)  # -> NullFlags, InvalidFlags, Description; disabled
dispatch_17 = Dispatch(List=circle_3, DispatchPattern=null_13.NullFlags)  # -> ListA, ListB; disabled
crv_6 = Curve(dispatch_17.ListB)  # disabled

area_8 = Area(Geometry=flatten(circle.Circle))  # -> Area, Centroid; disabled
volume_5 = Volume(Geometry=mesh_6)  # -> Volume, Centroid; disabled
item_17 = ListItem(List=area_8.Centroid, Index=number_slider_8, Wrap=True)  # disabled
vec2pt_4 = Vector2Pt(PointA=partition_3, PointB=graft(volume_5.Centroid), Unitize=False)  # -> Vector, Length; disabled
dist_3 = Distance(PointA=item_17, PointB=item_15)  # disabled
amp_4 = Amplitude(Vector=vec2pt_4.Vector, Amplitude=dist_3)  # disabled
pt_20 = Point(partition_3)  # disabled
ln_8 = Line(StartPoint=partition_3, EndPoint=graft(volume_5.Centroid))  # disabled
move_8 = Move(Geometry=pt_20, Motion=amp_4)  # -> Geometry, Transform; disabled
item_18 = ListItem(List=flatten(circle.Radius), Index=number_slider_8, Wrap=True)  # disabled
circle_4 = CircleCNR(Center=move_8.Geometry, Normal=ln_8, Radius=item_18)  # disabled
null_14 = NullItem(Item=circle_4)  # -> NullFlags, InvalidFlags, Description; disabled
dispatch_18 = Dispatch(List=circle_4, DispatchPattern=null_14.NullFlags)  # -> ListA, ListB; disabled
crv_7 = Curve(dispatch_18.ListB)  # disabled

panel_8 = Panel(pt_18)

null_15 = NullItem(Item=flatten(partition_3))  # -> NullFlags, InvalidFlags, Description
cset = CreateSet(List=null_15.NullFlags)  # -> Set, Map
dispatch_19 = Dispatch(List=flatten(partition_3), DispatchPattern=cset.Map)  # -> ListA, ListB
weave_5 = Weave(Pattern=cset.Map, Stream0=flatten(pt_18), Stream1=flatten(dispatch_19.ListA), NullGaps=False)
partition_4 = PartitionList(List=weave_5, Size="4")
group = Group(Objects=partition_4)  # -> flatten(Group)

panel_9 = Panel(ln_7)  # disabled

# ---- group: reorienting collar flanges_BROKEN / WIP
divide_3 = DivideCurve(Curve=rotate_3.Geometry, Count=panel_4, Kinks=False)  # -> Points, Tangents, Parameters; disabled
divide_4 = DivideCurve(Curve=rotate_4.Geometry, Count=panel_4, Kinks=False)  # -> Points, Tangents, Parameters; disabled
ln_9 = Line(StartPoint=flatten(divide_4.Points), EndPoint=flatten(divide_3.Points))  # -> graft(Line); disabled

divide_5 = DivideCurve(Curve=flatten(offset), Count=panel_4, Kinks=False)  # -> Points, Tangents, Parameters; disabled
divide_6 = DivideCurve(Curve=flatten(offset_2), Count=panel_4, Kinks=False)  # -> Points, Tangents, Parameters; disabled
ln_10 = Line(StartPoint=flatten(divide_6.Points), EndPoint=flatten(divide_5.Points))  # -> graft(Line); disabled

# ---- group: check for anchor alignment
number_slider_11 = Slider(300, range=0..1000)
group_2 = Group(Objects=partition_3)
group_3 = Group(Objects=wbvertices)
item_19 = ListItem(List=flatten(group_2), Index=number_slider_11, Wrap=True)
item_20 = ListItem(List=flatten(mesh_6), Index=number_slider_11, Wrap=True)
item_21 = ListItem(List=flatten(group_3), Index=number_slider_11, Wrap=True)
item_22 = ListItem(List=flatten(group), Index=number_slider_11, Wrap=True)
ungroup = Ungroup(Group=item_22)
ungroup_2 = Ungroup(Group=item_19)

# ----
rotate_5 = Rotate(Geometry=crv_7, Angle=degrees(number_slider_9), Plane=crv_7)  # -> graft(Geometry), Transform; disabled
rotate_6 = Rotate(Geometry=crv_6, Angle=degrees(number_slider_9), Plane=crv_6)  # -> graft(Geometry), Transform; disabled
number_slider_12 = Slider(6, range=0..10)  # disabled
neg_4 = Negative(Value=number_slider_12)  # disabled
offset_3 = OffsetCurve(Curve=rotate_5.Geometry, Distance=neg_4, Plane=rotate_5.Geometry, Corners=1)  # disabled
offset_4 = OffsetCurve(Curve=rotate_6.Geometry, Distance=neg_4, Plane=rotate_6.Geometry, Corners=1)  # disabled

panel_10 = Panel(dispatch_19.ListA)
panel_11 = Panel(ungroup_2)
panel_12 = Panel(ungroup)

# ---- group: reorienting collar flanges_BROKEN / WIP
loft = Loft(Curves=[ln_10, ln_9], Options={Adjust=False, Closed=False, LoftEnds=0, LoftSimp=0, LoftType=0, Rebuild=10, Refit=0.01})  # disabled
number_slider_13 = Slider(5, range=0..10)  # disabled
edges_2 = BrepEdges(Brep=loft)  # -> Naked, Interior, NonManifold; disabled
join_4 = JoinCurves(Curves=edges_2.Naked, Preserve=False)  # disabled
panel_13 = Panel("3")  # disabled
fillet = Fillet(Curve=join_4, Radius=number_slider_13)  # disabled
srf_4 = Surface(fillet)  # disabled
partition_5 = PartitionList(List=flatten(srf_4), Size=panel_13)  # disabled
flip_2 = FlipMatrix(Data=partition_5)  # disabled
item_23 = ListItem(List=flip_2, Index=0, Wrap=True)  # disabled

cluster_2 = Cluster_5(
    B_2=volume_3.Centroid,
    G_3=offset_4,
    O=item_23,
    L=offset,
    L_2=divide_3.Points,
    C_2=volume_3.Centroid,
    G_2=offset_4,
    C=offset_4,
    G=offset_3,
    P=offset_4,
    C_4=rotate_6.Geometry,
    B=brep_7,
    C_3=rotate_6.Geometry,
    L_3=divide_3.Points)  # disabled

# ---- group: corner caps cones
loft_2 = Loft(
    Curves=[offset_3, offset_4],
    Options={Adjust=False, Closed=False, LoftEnds=0, LoftSimp=0, LoftType=0, Rebuild=10, Refit=0.01})
loft_3 = Loft(
    Curves=[rotate_5.Geometry, rotate_6.Geometry],
    Options={Adjust=False, Closed=False, LoftEnds=0, LoftSimp=0, LoftType=0, Rebuild=10, Refit=0.01})

# ---- group: pre stressing cells
number_slider_14 = Slider(1.41, range=0..1.8)
number_slider_15 = Slider(1.33, range=0..2)

subtraction = Subtraction(A=number_slider_15, B=number_slider_14)
subtraction_2 = Subtraction(A=subtraction, B=number_slider_15)
abs = Absolute(Value=subtraction_2)
abs_2 = Absolute(Value=subtraction)
multiplication_7 = Multiplication(A=abs, B=0.5)
subtraction_3 = Subtraction(A=abs_2, B=abs)
abs_3 = Absolute(Value=subtraction_3)

# ----
panel_14 = Panel(multiplication_7)

# ---- group: pre stressing cells (continued)
cluster_3 = Cluster(mesh=mesh_2, A=abs_3, B=abs_2)
cluster_4 = Cluster(mesh=mesh_3, A=abs, B=multiplication_7)
cluster_5 = Cluster(mesh=mesh_4, A=abs_2, B=abs)
cluster_6 = Cluster(mesh=mesh_5, A=abs, B=multiplication_7)

mesh_7 = Mesh(cluster_4)
mesh_8 = Mesh(cluster_5)
mesh_9 = Mesh(cluster_3)
mesh_10 = Mesh(cluster_6)

mesh_11 = Mesh(mesh_9)
mesh_12 = Mesh(mesh_7)
mesh_13 = Mesh(mesh_8)
mesh_14 = Mesh(mesh_10)

# ----
merge_7 = Merge(Data1=mesh_11, Data2=mesh_12, Data3=mesh_13, Data4=mesh_14)

lng_2 = ListLength(List=mesh_11)
lng_3 = ListLength(List=mesh_12)
lng_4 = ListLength(List=mesh_13)
lng_5 = ListLength(List=mesh_14)
entwine = Entwine(Branch00=lng_2, Branch01=lng_3, Branch02=lng_4, Branch03=lng_5, FlattenInputs=True)  # -> flatten(Result)
partition_6 = PartitionList(List=group, Size=entwine)  # -> simplify(Chunks)

lng_6 = ListLength(List=mesh_11)
lng_7 = ListLength(List=mesh_12)
lng_8 = ListLength(List=mesh_13)
lng_9 = ListLength(List=mesh_14)
entwine_2 = Entwine(Branch00=lng_6, Branch01=lng_7, Branch02=lng_8, Branch03=lng_9, FlattenInputs=True)  # -> flatten(Result)
partition_7 = PartitionList(List=merge_7, Size=entwine_2)  # -> simplify(Chunks)

mesh_15 = Mesh(merge_7)

number_slider_16 = Slider(0, range=0..3)
number_slider_17 = Slider(1, range=0..3)
number_slider_18 = Slider(2, range=0..3)
number_slider_19 = Slider(3, range=0..3)
mesh_16 = Mesh(flatten(mesh_15))

# ---- group: groups of useable archoring points
branch = TreeBranch(Tree=partition_6, Path=number_slider_16, MaintainPaths=True)
branch_2 = TreeBranch(Tree=partition_6, Path=number_slider_17, MaintainPaths=True)
branch_3 = TreeBranch(Tree=partition_6, Path=number_slider_18, MaintainPaths=True)
branch_4 = TreeBranch(Tree=partition_6, Path=number_slider_19, MaintainPaths=True)

# ---- group: groups of cell types
branch_5 = TreeBranch(Tree=partition_7, Path=number_slider_16, MaintainPaths=True)
branch_6 = TreeBranch(Tree=partition_7, Path=number_slider_17, MaintainPaths=True)
branch_7 = TreeBranch(Tree=partition_7, Path=number_slider_18, MaintainPaths=True)
branch_8 = TreeBranch(Tree=partition_7, Path=number_slider_19, MaintainPaths=True)

# ---- group: old
panel_15 = Panel("""0
1
2""")  # disabled
cluster_7 = Cluster_4(L=branch, L_3=branch, P=panel_15, L_2=mesh_16, P_2=panel_15)  # disabled

# ----
ungroup_3 = Ungroup(Group=[branch, branch_2, branch_3, branch_4])

panel_16 = Panel(ungroup_3)

null_16 = NullItem(Item=ungroup_3)  # -> NullFlags, InvalidFlags, Description
pt_21 = Point(ungroup_3)
dispatch_20 = Dispatch(List=pt_21, DispatchPattern=null_16.NullFlags)  # -> ListA, ListB
pt_22 = Point(dispatch_20.ListB)

mesh_17 = Mesh(mesh_16)
nv = NakedVertices(Mesh=mesh_17)  # -> ClothedIndex, NakedIndex, ClothedPts, NakedPts
pt_23 = Point(nv.ClothedPts)

cps_3 = ClosestPoints(Point=ungroup_3, Cloud=pt_23, Count="1")  # -> ClosestPoint, CPIndex, Distance

anchor = Anchor(Point=flatten(cps_3.ClosestPoint), Target=flatten(pt_22), Strength=Slider(5499, range=0..10000))

medges = MeshEdges(Mesh=mesh_17)  # -> NakedEdges, InteriorEdges, NonManifoldEdges
crv_8 = Curve(medges.InteriorEdges)
len = Length(Curve=crv_8)
number_slider_20 = Slider(63, range=0..100)
multiplication_8 = Multiplication(A=len, B=Slider(0.4, range=-2..2))

bbox = BoundingBox(Content=mesh_17, Plane=PlaneXY(0, 0, 0))  # -> Box, Box_2
volume_6 = Volume(Geometry=bbox.Box)  # -> Volume, Centroid
pdecon = Deconstruct(Point=volume_6.Centroid)  # -> XComponent, YComponent, ZComponent
number_slider_21 = Slider(1.5, range=0.1..2)
bnd_2 = Bounds(Numbers=pdecon.ZComponent)
dom_2 = ConstructDomain(DomainStart=Slider(0.1, range=0.1..2), DomainEnd=number_slider_21)
remap_2 = RemapNumbers(Value=pdecon.ZComponent, Source=bnd_2, Target=dom_2)  # -> Mapped, Clipped

# ---- group: use this to treat the cell groups' physics differently
cluster_8 = Cluster_3(
    G=branch,
    reset=button,
    mesh=branch_5,
    G_3=branch_2,
    reset_2=button,
    mesh_4=branch_6,
    G_4=branch_3,
    reset_3=button,
    mesh_5=branch_7,
    G_2=branch_4,
    reset_4=button,
    mesh_3=branch_8)  # -> R, S_3, R_2, S, R_3, S_2, R_4, S_4; disabled

# ----
zombiesolver = ZombieSolver(GoalObjects=cluster_8.R, Threshold=1e-10, Tolerance=0.01, MaxIterations=number_slider_10)  # -> I, V, flatten(O)
zombiesolver_2 = ZombieSolver(GoalObjects=cluster_8.R_2, Threshold=1e-10, Tolerance=0.01, MaxIterations=number_slider_10)  # -> I, V, flatten(O)
zombiesolver_3 = ZombieSolver(GoalObjects=cluster_8.R_3, Threshold=1e-10, Tolerance=0.01, MaxIterations=number_slider_10)  # -> I, V, flatten(O)
zombiesolver_4 = ZombieSolver(GoalObjects=cluster_8.R_4, Threshold=1e-10, Tolerance=0.01, MaxIterations=number_slider_10)  # -> I, V, flatten(O)

item_24 = ListItem(List=zombiesolver.O, Index=cluster_8.S_3, Wrap=True)
item_25 = ListItem(List=zombiesolver_2.O, Index=cluster_8.S, Wrap=True)
item_26 = ListItem(List=zombiesolver_3.O, Index=cluster_8.S_2, Wrap=True)
item_27 = ListItem(List=zombiesolver_4.O, Index=cluster_8.S_4, Wrap=True)

swatch = ColourSwatch(SwatchColor=RGB(217, 139, 255))  # disabled
swatch_2 = ColourSwatch(SwatchColor=RGB(112, 94, 255))  # disabled
swatch_3 = ColourSwatch(SwatchColor=RGB(192, 73, 87))  # disabled
swatch_4 = ColourSwatch(SwatchColor=RGB(23, 100, 62))  # disabled
preview = CustomPreview(Geometry=item_24, Material=swatch)  # disabled
preview_2 = CustomPreview(Geometry=item_25, Material=swatch_2)  # disabled
preview_3 = CustomPreview(Geometry=item_26, Material=swatch_3)  # disabled
preview_4 = CustomPreview(Geometry=item_27, Material=swatch_4)  # disabled

pt_24 = Point(flatten(pt_23))
number_slider_22 = Slider(411, range=0..1000)
anchor_2 = Anchor(Point=flatten(pt_23), Target=flatten(pt_23), Strength=number_slider_22)
length_line = LengthLine(Line=crv_8, Length=multiplication_8, Strength=number_slider_20)
length_line_2 = LengthLine(Line=crv_8, Length=multiplication_8, Strength=number_slider_20)
lng_10 = ListLength(List=mesh_17)
series = Series(Start=0, Step=1, Count=lng_10)
swatch_5 = ColourSwatch(SwatchColor=RGB(217, 139, 255))  # disabled

neg_5 = Negative(Value=Slider(1, range=0..10000))
sc = SphereCollide(Points=pt_24, Radius=Slider(62, range=0..100), Strength=Slider(1000, range=0..1000))
anchor_3 = Anchor(Point=flatten(pt_23), Target=flatten(pt_23), Strength=number_slider_22)
pressure = Pressure(M=mesh_17, Strength=number_slider_21)
show = Show(G=mesh_17)
load = Load(Point=pt_23, ForceVector=Vector(0, 0, 1), Weighting=neg_5)  # disabled

merge_8 = Merge(Data1=show, Data2=anchor, Data3=pressure, Data4=length_line, Data5=load, Data6=anchor_3, Data7=sc)
solver = Solver(GoalObjects=merge_8, Reset=Button(), Threshold=1e-15, Tolerance=0.01, On=True)  # -> I, V, flatten(O); disabled
zombiesolver_5 = ZombieSolver(GoalObjects=merge_8, Threshold=1e-10, Tolerance=0.01, MaxIterations=Slider(100, range=0..100))  # -> I, V, flatten(O); disabled
item_28 = ListItem(List=zombiesolver_5.O, Index=series, Wrap=True)
preview_5 = CustomPreview(Geometry=item_28, Material=swatch_5)  # disabled

# ---- group: dispatch final forms by group
lng_11 = ListLength(List=mesh_11)
lng_12 = ListLength(List=mesh_12)
lng_13 = ListLength(List=mesh_13)
lng_14 = ListLength(List=mesh_14)
entwine_3 = Entwine(Branch00=lng_11, Branch01=lng_12, Branch02=lng_13, Branch03=lng_14, FlattenInputs=True)  # -> flatten(Result)
partition_8 = PartitionList(List=solver.O, Size=entwine_3)  # -> simplify(Chunks)
branch_9 = TreeBranch(Tree=partition_8, Path="{0}", MaintainPaths=True)
branch_10 = TreeBranch(Tree=partition_8, Path="{1}", MaintainPaths=True)
branch_11 = TreeBranch(Tree=partition_8, Path="{2}", MaintainPaths=True)
branch_12 = TreeBranch(Tree=partition_8, Path="{3}", MaintainPaths=True)
mesh_18 = Mesh(branch_10)
mesh_19 = Mesh(branch_12)
mesh_20 = Mesh(branch_11)
mesh_21 = Mesh(branch_9)

# ==== cluster Cluster
mesh = ClusterInput()
mesh_2 = Mesh(mesh)
volume = Volume(Geometry=mesh_2)  # -> Volume, Centroid
A = ClusterInput()
B = ClusterInput()

pdecon = Deconstruct(Point=flatten(volume.Centroid))  # -> XComponent, YComponent, ZComponent
bnd = Bounds(Numbers=pdecon.ZComponent)
dom = ConstructDomain(DomainStart=A, DomainEnd=B)
remap = RemapNumbers(Value=pdecon.ZComponent, Source=bnd, Target=dom)  # -> Mapped, Clipped
num = Number(remap.Mapped)

scale = Scale(Geometry=mesh_2, Center=volume.Centroid, Factor=num)  # -> Geometry, Transform
wbtriangles = WeaverbirdsSplitTrianglesSubdivision(MeshCurves=scale.Geometry, Level=Slider(2, range=0..10))
wbloop = WeaverbirdsLoopSubdivision(MeshCurves=wbtriangles, Level=1, SmoothNakedEdges=0)
mesh_3 = Mesh(flatten(wbloop))

mesh_4 = ClusterOutput(mesh_3)

# ==== cluster Cluster_2
L = ClusterInput()
P = ClusterInput()

sift = SiftPattern(List=L, SiftPattern=graft(P))  # -> Output0, Output1, Output2, Output3; disabled
null = NullItem(Item=sift.Output0)  # -> NullFlags, InvalidFlags, Description; disabled
null_2 = NullItem(Item=sift.Output1)  # -> NullFlags, InvalidFlags, Description; disabled
null_3 = NullItem(Item=sift.Output2)  # -> NullFlags, InvalidFlags, Description; disabled
null_4 = NullItem(Item=sift.Output3)  # -> NullFlags, InvalidFlags, Description; disabled
dispatch = Dispatch(List=sift.Output0, DispatchPattern=null.NullFlags)  # -> ListA, ListB; disabled
dispatch_2 = Dispatch(List=sift.Output1, DispatchPattern=null_2.NullFlags)  # -> ListA, ListB; disabled
dispatch_3 = Dispatch(List=sift.Output2, DispatchPattern=null_3.NullFlags)  # -> ListA, ListB; disabled
dispatch_4 = Dispatch(List=sift.Output3, DispatchPattern=null_4.NullFlags)  # -> ListA, ListB; disabled
pt = Point(dispatch_4.ListB)  # disabled
pt_2 = Point(dispatch.ListB)  # disabled
pt_3 = Point(dispatch_3.ListB)  # disabled
pt_4 = Point(dispatch_2.ListB)  # disabled
merge = Merge(Data1=pt_2, Data2=pt_4, Data4=pt_3, Data5=pt)  # disabled
pt_5 = Point(merge)  # disabled

_0 = ClusterOutput(sift.Output0)

# ==== cluster Cluster_3
mesh = ClusterInput()
mesh_2 = Mesh(flatten(mesh))
G = ClusterInput()
ungroup = Ungroup(Group=G)

null = NullItem(Item=ungroup)  # -> NullFlags, InvalidFlags, Description
pt = Point(ungroup)
dispatch = Dispatch(List=pt, DispatchPattern=null.NullFlags)  # -> ListA, ListB
pt_2 = Point(dispatch.ListB)

G_2 = ClusterInput()
mesh_3 = ClusterInput()
G_3 = ClusterInput()
G_4 = ClusterInput()
mesh_4 = ClusterInput()
mesh_5 = ClusterInput()
ungroup_2 = Ungroup(Group=G_2)
mesh_6 = Mesh(flatten(mesh_3))

null_2 = NullItem(Item=ungroup_2)  # -> NullFlags, InvalidFlags, Description
pt_3 = Point(ungroup_2)
dispatch_2 = Dispatch(List=pt_3, DispatchPattern=null_2.NullFlags)  # -> ListA, ListB
pt_4 = Point(dispatch_2.ListB)

ungroup_3 = Ungroup(Group=G_3)

null_3 = NullItem(Item=ungroup_3)  # -> NullFlags, InvalidFlags, Description
pt_5 = Point(ungroup_3)
dispatch_3 = Dispatch(List=pt_5, DispatchPattern=null_3.NullFlags)  # -> ListA, ListB
pt_6 = Point(dispatch_3.ListB)

ungroup_4 = Ungroup(Group=G_4)

null_4 = NullItem(Item=ungroup_4)  # -> NullFlags, InvalidFlags, Description
pt_7 = Point(ungroup_4)
dispatch_4 = Dispatch(List=pt_7, DispatchPattern=null_4.NullFlags)  # -> ListA, ListB
pt_8 = Point(dispatch_4.ListB)

mesh_7 = Mesh(flatten(mesh_4))
mesh_8 = Mesh(flatten(mesh_5))
mesh_9 = Mesh(mesh_7)
mesh_10 = Mesh(mesh_8)
panel = Panel(ungroup)
mesh_11 = Mesh(mesh_6)
mesh_12 = Mesh(mesh_2)
nv = NakedVertices(Mesh=mesh_12)  # -> ClothedIndex, NakedIndex, ClothedPts, NakedPts
nv_2 = NakedVertices(Mesh=mesh_9)  # -> ClothedIndex, NakedIndex, ClothedPts, NakedPts
nv_3 = NakedVertices(Mesh=mesh_10)  # -> ClothedIndex, NakedIndex, ClothedPts, NakedPts
nv_4 = NakedVertices(Mesh=mesh_11)  # -> ClothedIndex, NakedIndex, ClothedPts, NakedPts
panel_2 = Panel(ungroup_3)
panel_3 = Panel(ungroup_4)
pt_9 = Point(nv.ClothedPts)

cps = ClosestPoints(Point=ungroup, Cloud=pt_9, Count="1")  # -> ClosestPoint, CPIndex, Distance

panel_4 = Panel(ungroup_2)
pt_10 = Point(nv_2.ClothedPts)

cps_2 = ClosestPoints(Point=ungroup_3, Cloud=pt_10, Count="1")  # -> ClosestPoint, CPIndex, Distance

pt_11 = Point(nv_3.ClothedPts)

cps_3 = ClosestPoints(Point=ungroup_4, Cloud=pt_11, Count="1")  # -> ClosestPoint, CPIndex, Distance

pt_12 = Point(nv_4.ClothedPts)

cps_4 = ClosestPoints(Point=ungroup_2, Cloud=pt_12, Count="1")  # -> ClosestPoint, CPIndex, Distance

anchor = Anchor(Point=flatten(cps.ClosestPoint), Target=flatten(pt_2), Strength=Slider(5499, range=0..10000))

anchor_2 = Anchor(Point=flatten(cps_2.ClosestPoint), Target=flatten(pt_6), Strength=Slider(5499, range=0..10000))

anchor_3 = Anchor(Point=flatten(cps_3.ClosestPoint), Target=flatten(pt_8), Strength=Slider(5499, range=0..10000))

anchor_4 = Anchor(Point=flatten(cps_4.ClosestPoint), Target=flatten(pt_4), Strength=Slider(5499, range=0..10000))

medges = MeshEdges(Mesh=mesh_12)  # -> NakedEdges, InteriorEdges, NonManifoldEdges
crv = Curve(medges.InteriorEdges)
len = Length(Curve=crv)
number_slider = Slider(63, range=0..100)
multiplication = Multiplication(A=len, B=Slider(0.4, range=-2..2))

medges_2 = MeshEdges(Mesh=mesh_9)  # -> NakedEdges, InteriorEdges, NonManifoldEdges
crv_2 = Curve(medges_2.InteriorEdges)
len_2 = Length(Curve=crv_2)
number_slider_2 = Slider(63, range=0..100)
multiplication_2 = Multiplication(A=len_2, B=Slider(0.4, range=-2..2))

medges_3 = MeshEdges(Mesh=mesh_10)  # -> NakedEdges, InteriorEdges, NonManifoldEdges
crv_3 = Curve(medges_3.InteriorEdges)
len_3 = Length(Curve=crv_3)
number_slider_3 = Slider(63, range=0..100)
multiplication_3 = Multiplication(A=len_3, B=Slider(0.4, range=-2..2))

medges_4 = MeshEdges(Mesh=mesh_11)  # -> NakedEdges, InteriorEdges, NonManifoldEdges
crv_4 = Curve(medges_4.InteriorEdges)
len_4 = Length(Curve=crv_4)
number_slider_4 = Slider(63, range=0..100)
multiplication_4 = Multiplication(A=len_4, B=Slider(0.4, range=-2..2))

pt_13 = Point(flatten(pt_9))

bbox = BoundingBox(Content=mesh_12, Plane=PlaneXY(0, 0, 0))  # -> Box, Box_2
volume = Volume(Geometry=bbox.Box)  # -> Volume, Centroid
pdecon = Deconstruct(Point=volume.Centroid)  # -> XComponent, YComponent, ZComponent
number_slider_5 = Slider(1.5, range=0.1..2)
bnd = Bounds(Numbers=pdecon.ZComponent)
dom = ConstructDomain(DomainStart=Slider(0.1, range=0.1..2), DomainEnd=number_slider_5)
remap = RemapNumbers(Value=pdecon.ZComponent, Source=bnd, Target=dom)  # -> Mapped, Clipped

pt_14 = Point(flatten(pt_10))
pt_15 = Point(flatten(pt_11))
number_slider_6 = Slider(411, range=0..1000)
pt_16 = Point(flatten(pt_12))

bbox_2 = BoundingBox(Content=mesh_9, Plane=PlaneXY(0, 0, 0))  # -> Box, Box_2
volume_2 = Volume(Geometry=bbox_2.Box)  # -> Volume, Centroid
pdecon_2 = Deconstruct(Point=volume_2.Centroid)  # -> XComponent, YComponent, ZComponent
number_slider_7 = Slider(1.5, range=0.1..2)
bnd_2 = Bounds(Numbers=pdecon_2.ZComponent)
dom_2 = ConstructDomain(DomainStart=Slider(0.3, range=0.1..2), DomainEnd=number_slider_7)
remap_2 = RemapNumbers(Value=pdecon_2.ZComponent, Source=bnd_2, Target=dom_2)  # -> Mapped, Clipped

bbox_3 = BoundingBox(Content=mesh_10, Plane=PlaneXY(0, 0, 0))  # -> Box, Box_2
volume_3 = Volume(Geometry=bbox_3.Box)  # -> Volume, Centroid
pdecon_3 = Deconstruct(Point=volume_3.Centroid)  # -> XComponent, YComponent, ZComponent
number_slider_8 = Slider(1.5, range=0.1..2)
bnd_3 = Bounds(Numbers=pdecon_3.ZComponent)
dom_3 = ConstructDomain(DomainStart=Slider(0.3, range=0.1..2), DomainEnd=number_slider_8)
remap_3 = RemapNumbers(Value=pdecon_3.ZComponent, Source=bnd_3, Target=dom_3)  # -> Mapped, Clipped

bbox_4 = BoundingBox(Content=mesh_11, Plane=PlaneXY(0, 0, 0))  # -> Box, Box_2
volume_4 = Volume(Geometry=bbox_4.Box)  # -> Volume, Centroid
pdecon_4 = Deconstruct(Point=volume_4.Centroid)  # -> XComponent, YComponent, ZComponent
number_slider_9 = Slider(1.5, range=0.1..2)
bnd_4 = Bounds(Numbers=pdecon_4.ZComponent)
dom_4 = ConstructDomain(DomainStart=Slider(0.3, range=0.1..2), DomainEnd=number_slider_9)
remap_4 = RemapNumbers(Value=pdecon_4.ZComponent, Source=bnd_4, Target=dom_4)  # -> Mapped, Clipped

number_slider_10 = Slider(411, range=0..1000)
number_slider_11 = Slider(411, range=0..1000)
number_slider_12 = Slider(411, range=0..1000)

neg = Negative(Value=Slider(1, range=0..10000))
sc = SphereCollide(Points=pt_13, Radius=Slider(62, range=0..100), Strength=Slider(1000, range=0..1000))
anchor_5 = Anchor(Point=flatten(pt_9), Target=flatten(pt_9), Strength=number_slider_6)
pressure = Pressure(M=mesh_12, Strength=number_slider_5)
show = Show(G=mesh_12)
load = Load(Point=pt_9, ForceVector=Vector(0, 0, 1), Weighting=neg)  # disabled

anchor_6 = Anchor(Point=flatten(pt_9), Target=flatten(pt_9), Strength=number_slider_6)
length_line = LengthLine(Line=crv, Length=multiplication, Strength=number_slider)
length_line_2 = LengthLine(Line=crv, Length=multiplication, Strength=number_slider)

neg_2 = Negative(Value=Slider(1, range=0..10000))
sc_2 = SphereCollide(Points=pt_14, Radius=Slider(62, range=0..100), Strength=Slider(1000, range=0..1000))
anchor_7 = Anchor(Point=flatten(pt_10), Target=flatten(pt_10), Strength=number_slider_10)
pressure_2 = Pressure(M=mesh_9, Strength=number_slider_7)
show_2 = Show(G=mesh_9)
load_2 = Load(Point=pt_10, ForceVector=Vector(0, 0, 1), Weighting=neg_2)  # disabled

neg_3 = Negative(Value=Slider(1, range=0..10000))
sc_3 = SphereCollide(Points=pt_15, Radius=Slider(62, range=0..100), Strength=Slider(1000, range=0..1000))
anchor_8 = Anchor(Point=flatten(pt_11), Target=flatten(pt_11), Strength=number_slider_11)
pressure_3 = Pressure(M=mesh_10, Strength=number_slider_8)
show_3 = Show(G=mesh_10)
load_3 = Load(Point=pt_11, ForceVector=Vector(0, 0, 1), Weighting=neg_3)  # disabled

neg_4 = Negative(Value=Slider(1, range=0..10000))
sc_4 = SphereCollide(Points=pt_16, Radius=Slider(62, range=0..100), Strength=Slider(1000, range=0..1000))
anchor_9 = Anchor(Point=flatten(pt_12), Target=flatten(pt_12), Strength=number_slider_12)
pressure_4 = Pressure(M=mesh_11, Strength=number_slider_9)
show_4 = Show(G=mesh_11)
load_4 = Load(Point=pt_12, ForceVector=Vector(0, 0, 1), Weighting=neg_4)  # disabled

anchor_10 = Anchor(Point=flatten(pt_10), Target=flatten(pt_10), Strength=number_slider_10)
anchor_11 = Anchor(Point=flatten(pt_11), Target=flatten(pt_11), Strength=number_slider_11)
anchor_12 = Anchor(Point=flatten(pt_12), Target=flatten(pt_12), Strength=number_slider_12)
length_line_3 = LengthLine(Line=crv_2, Length=multiplication_2, Strength=number_slider_2)
length_line_4 = LengthLine(Line=crv_3, Length=multiplication_3, Strength=number_slider_3)
length_line_5 = LengthLine(Line=crv_2, Length=multiplication_2, Strength=number_slider_2)
length_line_6 = LengthLine(Line=crv_3, Length=multiplication_3, Strength=number_slider_3)
length_line_7 = LengthLine(Line=crv_4, Length=multiplication_4, Strength=number_slider_4)
length_line_8 = LengthLine(Line=crv_4, Length=multiplication_4, Strength=number_slider_4)
merge = Merge(Data1=show, Data2=anchor, Data3=pressure, Data4=length_line, Data5=load, Data6=anchor_5, Data7=sc)
merge_2 = Merge(Data1=show_2, Data2=anchor_2, Data3=pressure_2, Data4=length_line_3, Data5=load_2, Data6=anchor_7, Data7=sc_2)
merge_3 = Merge(Data1=show_3, Data2=anchor_3, Data3=pressure_3, Data4=length_line_4, Data5=load_3, Data6=anchor_8, Data7=sc_3)
R = ClusterOutput(merge)
merge_4 = Merge(Data1=show_4, Data2=anchor_4, Data3=pressure_4, Data4=length_line_7, Data5=load_4, Data6=anchor_9, Data7=sc_4)
button = Button()
button_2 = Button()
button_3 = Button()
reset = ClusterInput()
R_2 = ClusterOutput(merge_2)
R_3 = ClusterOutput(merge_3)
R_4 = ClusterOutput(merge_4)
solver = Solver(GoalObjects=merge, Reset=reset, Threshold=1e-15, Tolerance=0.01, On=True)  # -> I, V, flatten(O)
reset_2 = ClusterInput()
reset_3 = ClusterInput()
reset_4 = ClusterInput()
lng = ListLength(List=mesh_9)
lng_2 = ListLength(List=mesh_10)
lng_3 = ListLength(List=mesh_12)
lng_4 = ListLength(List=mesh_11)
solver_2 = Solver(GoalObjects=merge_2, Reset=reset_2, Threshold=1e-15, Tolerance=0.01, On=True)  # -> I, V, flatten(O); disabled
solver_3 = Solver(GoalObjects=merge_3, Reset=reset_3, Threshold=1e-15, Tolerance=0.01, On=True)  # -> I, V, flatten(O); disabled
solver_4 = Solver(GoalObjects=merge_4, Reset=reset_4, Threshold=1e-15, Tolerance=0.01, On=True)  # -> I, V, flatten(O); disabled
series = Series(Start=0, Step=1, Count=lng)
series_2 = Series(Start=0, Step=1, Count=lng_2)
series_3 = Series(Start=0, Step=1, Count=lng_3)
series_4 = Series(Start=0, Step=1, Count=lng_4)
S = ClusterOutput(series)
S_2 = ClusterOutput(series_2)
S_3 = ClusterOutput(series_3)
S_4 = ClusterOutput(series_4)

# ==== cluster Cluster_4
L = ClusterInput()
P = ClusterInput()
L_2 = ClusterInput()
P_2 = ClusterInput()
L_3 = ClusterInput()

sift = SiftPattern(List=L, SiftPattern=P)  # -> Output0, Output1, Output2
sift_2 = SiftPattern(List=L_2, SiftPattern=P_2)  # -> Output0, Output1, Output2
mesh = Mesh(sift_2.Output0)
null = NullItem(Item=sift_2.Output2)  # -> NullFlags, InvalidFlags, Description
null_2 = NullItem(Item=sift.Output2)  # -> NullFlags, InvalidFlags, Description
cset = CreateSet(List=null.NullFlags)  # -> Set, Map
cset_2 = CreateSet(List=null_2.NullFlags)  # -> Set, Map
dispatch = Dispatch(List=sift_2.Output2, DispatchPattern=cset.Map)  # -> ListA, ListB
dispatch_2 = Dispatch(List=L_3, DispatchPattern=cset_2.Map)  # -> ListA, ListB

# ==== cluster Cluster_5
L = ClusterInput()
C = ClusterInput()
G = ClusterInput()
L_2 = ClusterInput()
G_2 = ClusterInput()
P = ClusterInput()

divide = DivideCurve(Curve=C, Count="3", Kinks=False)  # -> Points, Tangents, Parameters
area = Area(Geometry=G)  # -> Area, Centroid
item = ListItem(List=divide.Points, Index=0, Wrap=True)  # -> Item, Item1, Item2
area_2 = Area(Geometry=G_2)  # -> Area, Centroid
mirror = Mirror(Geometry=area.Centroid, Plane=P)  # -> Geometry, Transform
pl_3pt = Plane3Pt(PointA=area_2.Centroid, PointB=item.Item, PointC=mirror.Geometry)

B = ClusterInput()
G_3 = ClusterInput()
B_2 = ClusterInput()
C_2 = ClusterInput()

item_2 = ListItem(List=flatten(L), Index=0, Wrap=True)
item_3 = ListItem(List=flatten(L_2), Index=0, Wrap=True)  # -> Item, Item1, Item2
area_3 = Area(Geometry=item_2)  # -> Area, Centroid
pl_3pt_2 = Plane3Pt(PointA=area_3.Centroid, PointB=item_3.Item, PointC=C_2)

edges = BrepEdges(Brep=B)  # -> Naked, Interior, NonManifold
area_4 = Area(Geometry=G_3)  # -> Area, Centroid
vec2pt = Vector2Pt(PointA=area_3.Centroid, PointB=B_2, Unitize=False)  # -> Vector, Length
C_3 = ClusterInput()
O = ClusterInput()
vec2pt_2 = Vector2Pt(PointA=area.Centroid, PointB=mirror.Geometry, Unitize=False)  # -> Vector, Length
pline = PolyLine(Vertices=[item_3.Item, item_3.Item1, item_3.Item2], Closed=True)
divide_2 = DivideCurve(Curve=C_3, Count="3", Kinks=False)  # -> Points, Tangents, Parameters
group = Group(Objects=flatten(O))
C_4 = ClusterInput()
explode = Explode(Curve=pline, Recursive=True)  # -> Segments, Vertices
mcx = MultipleCurves(Curves=flatten([pline, C_4]))  # -> Points, IndexA, IndexB, ParamA, ParamB
L_3 = ClusterInput()
rotate = Rotate(Geometry=divide_2.Points, Angle=1.570796327, Plane=PlaneXY(0, 0, 0))  # -> Geometry, Transform
midpt = CurveMiddle(Curve=explode.Segments)
item_4 = ListItem(List=L_3, Index=0, Wrap=True)  # -> Item, Item1, Item2
orient = Orient(Geometry=graft(group), Source=pl_3pt_2, Target=pl_3pt)  # -> Geometry, Transform
pline_2 = PolyLine(Vertices=divide_2.Points, Closed=True)
pline_3 = PolyLine(Vertices=midpt, Closed=True)
trimap = TriangleMapping(Geometry=group, Source=pline_3, Target=pline_2)  # -> Geometry, Transform
item_5 = ListItem(List=midpt, Index=0, Wrap=True)
